# Grasshopper definition columns workflow.ghx (Grasshopper 1.0.8)
# plug-ins: Speckle 2

# ---- group: RH_IN:Send
txt = Text()

# ----
panel = Panel("https://macad.speckle.xyz/projects/28a211b286/models/f5c0c919fa")
synchronous_receiver = SynchronousReceiver(Stream=txt, AutoReceive=False, selectedKitName="Objects")  # -> Data, Info
receive = Receive(
    Stream=panel,
    AutoReceive=False,
    CurrentComponentState="expired",
    ExpandOutput=True,
    LastInfoMessage="ERVA Hofi @ 03/19/2025 21:17:33: Pushed 50 elements from Grasshopper. (id:f6c21f573e)",
    ReceiveOnOpen=False,
    ReceivedCommitId="f6c21f573e",
    StreamWrapper="https://macad.speckle.xyz/projects/28a211b286/models/structure/towers/v4/floorplates",
    selectedKitName="Objects")  # -> Info, Data
surface = Surface(graft(synchronous_receiver.Data))
radius_bottom = Slider(26, range=10..30)
of_columns_main_beams = Slider(10, range=0..30)
radius_top = Slider(16, range=10..20)
is_planar = IsPlanar(Surface=surface, Interior=True)  # -> Planar, Plane
project = Project(Geometry=surface, Plane=is_planar.Plane)  # -> Geometry, Transform
area = Area(Geometry=project.Geometry)  # -> Area, graft(Centroid)
# Towers Structural System
list_item = ListItem(List=flatten(area.Centroid), Index=0, Wrap=True)  # -> Item1, Item
circle = Circle(Plane=list_item.Item1, Radius=radius_top)
circle_2 = Circle(Plane=list_item.Item, Radius=radius_bottom)
divide_curve = DivideCurve(Curve=circle, Count=of_columns_main_beams, Kinks=False)  # -> Points, Tangents, Parameters
divide_curve_2 = DivideCurve(Curve=circle_2, Count=of_columns_main_beams, Kinks=False)  # -> Points, Tangents, Parameters
line = Line(StartPoint=divide_curve.Points, EndPoint=divide_curve_2.Points)
surface_2 = Surface(flatten(surface))
panel_2 = Panel("""0
-1""")
cull_index = CullIndex(List=surface_2, Indices=panel_2, Wrap=True)  # -> graft(List)
split_with_breps = SplitWithBreps(Curve=line, Brep=flatten(cull_index))  # -> Curve, Points
panel_3 = Panel(line)
flip_matrix = FlipMatrix(Data=split_with_breps.Curve)
curve = Curve(flip_matrix)
series = Series(Start="1", Step=1, Count="47")
panel_4 = Panel(curve)
eval = Evaluate(F="3*((2+(N-2)*0.7)/N)", N=series)
ma = MassAddition(Input=eval)  # -> Result, PartialResults
total_load_kn = Panel(ma.Result)
sum_of_kn_floor = Panel(ma.PartialResults)
kn_floor = Panel(eval)
panel_5 = Panel(sum_of_kn_floor)
multiplication = Multiplication(A=panel_5, B="10000")
expression = Expression(P=multiplication, Expression="Sqrt(P / (10^7))")
panel_6 = Panel(expression)
len = Length(Curve=curve)
item = ListItem(List=len, Index=0, Wrap=True)
multiplication_2 = Multiplication(A=panel_6, B=Slider(2, range=0..10))
rectangle = Rectangle(Plane=curve, XSize=graft(multiplication_2), YSize=graft(multiplication_2), Radius=0)  # -> Rectangle, Length
neg = Negative(Value=item)
num = Number(multiplication)
multiplication_3 = Multiplication(A=multiplication_2, B="100")
srf = Surface(rectangle.Rectangle)
Z = UnitZ(Factor=neg)
expression_2 = Expression(P=num, L=multiplication_3, b=multiplication_2, E="20e9", Expression="(P * L) / (b^2 * E)")
panel_7 = Panel(multiplication_2)
extr = Extrude(Base=srf, Direction=Z)
panel_8 = Panel(expression_2)
multiplication_4 = Multiplication(A=panel_8, B="1000")
panel_9 = Panel(multiplication_4)
item_2 = ListItem(List=panel_9, Index="-1", Wrap=True)
panel_10 = Panel(item_2)
num_2 = Number(multiplication)

cso = CreateSpeckleObject(A=curve, selectedKitName="Objects")
cso_2 = CreateSpeckleObject(B=rectangle.Rectangle, selectedKitName="Objects")
cso_3 = CreateSpeckleObject(C=extr, selectedKitName="Objects")
panel_11 = Panel("https://macad.speckle.xyz/projects/28a211b286/models/4104f63f5f")
cso_4 = CreateSpeckleObject(ColumnsCurves=cso, CrossSection=cso_2, Columns=cso_3, Loads=num_2, selectedKitName="Objects")
send = Send(
    Stream=panel_11,
    Data=cso_4,
    AutoSend=True,
    BaseId="d84fc8a02fad2f98aad52d4dd7e685d2",
    CurrentComponentState="up_to_date",
    KitName="Objects",
    OutputWrappers="https://macad.speckle.xyz\t28a211b286\te0c4b5d59f",
    UseDefaultCache=True,
    selectedKitName="Objects")

receive_2 = Receive(
    Stream=panel_11,
    AutoReceive=True,
    CurrentComponentState="up_to_date",
    ExpandOutput=True,
    LastInfoMessage="ERVA Hofi @ 03/20/2025 00:55:54: Pushed 15934 elements from Grasshopper. (id:e0c4b5d59f)",
    ReceiveOnOpen=False,
    ReceivedCommitId="e0c4b5d59f",
    StreamWrapper="https://macad.speckle.xyz/projects/28a211b286/models/structure/towers/v4/columnscollab",
    selectedKitName="Objects")  # -> Info, Data
dso = DeconstructSpeckleObject(SpeckleObject=receive_2.Data, selectedKitName="Objects")  # -> ColumnsCurves, CrossSection, Loads
dso_2 = DeconstructSpeckleObject(SpeckleObject=dso.CrossSection, selectedKitName="Objects")
dso_3 = DeconstructSpeckleObject(SpeckleObject=dso.ColumnsCurves, selectedKitName="Objects")
crv = Curve(dso_3)
panel_12 = Panel(crv)
num_3 = Number(dso.Loads)
crv_2 = Curve(dso_2)
area_2 = Area(Geometry=crv_2)  # -> Area, Centroid
panel_13 = Panel(area_2.Area)
scale = Scale(Geometry=crv_2, Center=area_2.Centroid, Factor=Slider(1.1, range=0..10))  # -> Geometry, Transform
srf_2 = Surface(scale.Geometry)
area_3 = Area(Geometry=scale.Geometry)  # -> Area, Centroid
expression_3 = Expression(x=area_3.Area, Expression="sqrt(x)")
panel_14 = Panel(expression_3)
item_3 = ListItem(List=flatten(panel_14), Index="1", Wrap=True)
panel_15 = Panel(item_3)
multiplication_5 = Multiplication(A=expression_3, B=Slider(1, range=0..10))
multiplication_6 = Multiplication(A=multiplication_5, B="100")
rectangle_2 = Rectangle(Plane=crv, XSize=graft(panel_15), YSize=graft(panel_15), Radius=0)  # -> Rectangle, Length
srf_3 = Surface(rectangle_2.Rectangle)
expression_4 = Expression(P=num_3, L=multiplication_6, b=multiplication_5, E="20e9", Expression="(P * L) / (b^2 * E)")
panel_16 = Panel(multiplication_5)
extrcrv = ExtrudeAlong(Base=srf_3, Curve=crv)
extrcrv_2 = ExtrudeAlong(Base=srf_2, Curve=crv)
volume = Volume(Geometry=extrcrv)  # -> Volume, Centroid
panel_17 = Panel(expression_4)
panel_18 = Panel(area_3.Area)
volume_2 = Volume(Geometry=extrcrv_2)  # -> Volume, Centroid
panel_19 = Panel(volume.Volume)
ma_2 = MassAddition(Input=flatten(volume.Volume))  # -> Result, PartialResults
ma_3 = MassAddition(Input=flatten(volume_2.Volume))  # -> Result, PartialResults
panel_20 = Panel(volume_2.Volume)
panel_21 = Panel(ma_2.Result)
panel_22 = Panel(ma_3.Result)
multiplication_7 = Multiplication(A=panel_17, B="1000")
panel_23 = Panel(multiplication_7)
item_4 = ListItem(List=flatten(panel_23), Index="-1", Wrap=True)
division = Division(A=panel_22, B=panel_21)
panel_24 = Panel(item_4)
panel_25 = Panel(division)
num_4 = Number(num_3)

cso_5 = CreateSpeckleObject(A=crv, selectedKitName="Objects")
cso_6 = CreateSpeckleObject(B=scale.Geometry, selectedKitName="Objects")
cso_7 = CreateSpeckleObject(C=extrcrv_2, selectedKitName="Objects")
panel_26 = Panel("https://macad.speckle.xyz/projects/28a211b286/models/4104f63f5f")
cso_8 = CreateSpeckleObject(ColumnsCurves=cso_5, CrossSection=cso_6, Columns=cso_7, Loads=num_4, selectedKitName="Objects")
send_2 = Send(
    Stream=panel_26,
    Data=cso_8,
    AutoSend=False,
    BaseId="a0135dd64859e3444aa36d0ce6d816c8",
    CurrentComponentState="expired",
    KitName="Objects",
    OutputWrappers="https://macad.speckle.xyz\t28a211b286\tab89a92f18",
    UseDefaultCache=True,
    selectedKitName="Objects")

# ----
# change "project" for "streams": https://macad.speckle.xyz/streams/a63c4e60ed
panel_27 = Panel("Receive_From_Compute Stream")
panel_28 = Panel("Bot Speckle Token")
txt_2 = Text()
sgetwt = StreamGetWithToken(Stream=txt_2, AuthToken="0a7a2c01a136ad89e2cfa5e002c9f1bcbe5656a1d0")
ss = SynchronousSender(
    Data=cso_8,
    Stream=sgetwt,
    OutputWrappers="https://macad.speckle.xyz\t27b32e7bd2\tab5404b2dc",
    UseDefaultCache=True,
    selectedKitName="Objects")
